# Grasshopper definition Recursion.ghx (Grasshopper 0.8.13)

angle = Slider(65, range=0..80)
level = Slider(4, range=0..7)
line = Line(Line((1, 0, 0), (4, 3, 0)))
python = PythonScript(line=line, angle=angle, maxLevel=level, GhMemory=0)  # -> out, result; inputs angle: Double, maxLevel: Double
# ---------- python: Python ----------
import rhinoscriptsyntax as rs
import math


def Main():
    allLines = []
    SubdivideAndRotate(line, 0, allLines)
    global result
    result = ghdoc[allLines]


def SubdivideAndRotate(line, level, allLines):
    
    if level >= maxLevel:
        allLines.append(line)
        return
    
    start = rs.CurveStartPoint(line)
    end = rs.CurveEndPoint(line)
    second = (end - start) / 3.0 + start
    third = (end - start) * (2.0/3.0) + start
    middle = (end + start) * 0.5
    middle = rs.AddPoint(second + (middle - second) / math.cos(angle * math.pi / 180))
    middle = rs.RotateObject(middle, second, angle, [0,0,1], False)
    middle = rs.PointCoordinates(middle)
    
    level = level + 1
    
    SubdivideAndRotate(rs.AddLine(start, second), level, allLines)
    SubdivideAndRotate(rs.AddLine(second, middle), level, allLines)
    SubdivideAndRotate(rs.AddLine(middle, third), level, allLines)
    SubdivideAndRotate(rs.AddLine(third, end), level, allLines)


Main()
# ---------- end python ----------
