# Grasshopper definition test-definition.ghx (Grasshopper 0.8.13)

# RhinoScript
panel = Panel("""from math import sin, cos
import rhinoscriptsyntax as rs

ptList = [((cos(i*l)+60, sin(i*l), i*0.4))for i in range(0,100)]
pts = rs.AddPoints(ptList)

o = pts""")
# Retrieving values
# : inputs and outputs are special variable names
panel_2 = Panel("""first = i
second = ii

a = second
b = first""")
# Importing normal namespaces
panel_3 = Panel("""import math

a = i
a = [math.cos((a + i)/10.0) for i in xrange(20)]""")
# Simple attractors (RhinoCommon)
# ms = [(line.From + line.To) * 0.5 for line in lines]
# a = attractor
# f = strength
# oneLessF = 1 - f
# mids = [m * f + a * oneLessF for m in ms]
slider = Slider(0, range=0..200)
pt = Point(Point(-14, 11, 0))

# ---- group: list access
line = Line([Line((-20, 2, 0), (-13, -9, 0)), Line((-12, 0, 0), (-5, -12, 0)), Line((-2, 12, 0), (-6, 1, 0)), Line((6, 8, 0), (2, 0, 0)), Line((8, -1, 0), (14, -10, 0)), Line((16, -1, 0), (21, -12, 0)), Line((16, 17, 0), (-21, 21, 0)), Line((-17, -17, 0), (20, -16, 0)), Line((26, 13, 0), (27, -18, 0)), Line((-24, -18, 0), (-27, 16, 0))])

# ----
# ... there is a common document to all the definition.
# Variables are in one scope in the whole document
python = PythonInterpreter(i="this is some text", ii="9.0", GhMemory=0)  # -> out, a, b
#   port a: The result(s)
#   port b: Variable Data
# ---------- python: Python ----------
first = i
second = ii

a = second
b = first
# ---------- end python ----------
python_2 = PythonInterpreter(Code=panel_3, I=slider, GhMemory=0)  # -> Output, Result
python_3 = PythonInterpreter(lines=line, attractor=pt, strength=Slider(1, range=0..1), GhMemory=0)  # -> out, mids; inputs lines: list
#   port mids: The result(s)
# ---------- python_3: Python ----------
ms = [(line.From + line.To) * 0.5 for line in lines]
a = attractor
f = strength
oneLessF = 1 - f
mids = [m * f + a * oneLessF for m in ms]
# ---------- end python_3 ----------
python_4 = PythonInterpreter(Code=panel, L=Slider(0.443, range=0..1), GhMemory=-10)  # -> Output, Result
panel_4 = Panel(python.b)
panel_5 = Panel(python.a)
panel_6 = Panel(python_2.Result)
panel_7 = Panel(python_2.Output)
panel_8 = Panel(python_4.Result)
panel_9 = Panel(python_3.mids)
graph = QuickGraph(python_2.Result)
